test file "ForwardVehicleSensorFusionTests"
  coverage: Decision, MCDC, Condition

suite "Test Scenarios"

  case "scenario_LFACC_01_Curve_DecelTarget" [simulation]
    model ForwardVehicleSensorFusionTestBench
    post-load callback:
      scenarioName = "scenario_LFACC_01_Curve_DecelTarget";
      helperSLForwardVehicleSensorFusionSetup("scenarioFcnName",scenarioName);
    cleanup callback:
      helperPlotForwardVehicleSensorFusionResults(sltest_simout.logsout);

  case "scenario_LFACC_02_Curve_AutoRetarget" [simulation]
    model ForwardVehicleSensorFusionTestBench
    post-load callback:
      scenarioName = "scenario_LFACC_02_Curve_AutoRetarget";
      helperSLForwardVehicleSensorFusionSetup("scenarioFcnName",scenarioName);
    cleanup callback:
      helperPlotForwardVehicleSensorFusionResults(sltest_simout.logsout);

  case "scenario_LFACC_03_Curve_StopnGo" [simulation]
    model ForwardVehicleSensorFusionTestBench
    post-load callback:
      scenarioName = "scenario_LFACC_03_Curve_StopnGo";
      helperSLForwardVehicleSensorFusionSetup("scenarioFcnName",scenarioName);
    cleanup callback:
      helperPlotForwardVehicleSensorFusionResults(sltest_simout.logsout);

  case "scenario_LFACC_04_Curve_CutInOut" [simulation]
    model ForwardVehicleSensorFusionTestBench
    post-load callback:
      scenarioName = "scenario_LFACC_04_Curve_CutInOut";
      helperSLForwardVehicleSensorFusionSetup("scenarioFcnName",scenarioName);
    cleanup callback:
      helperPlotForwardVehicleSensorFusionResults(sltest_simout.logsout);

  case "scenario_LFACC_05_Curve_CutInOut_TooClose" [simulation]
    model ForwardVehicleSensorFusionTestBench
    post-load callback:
      scenarioName = "scenario_LFACC_05_Curve_CutInOut_TooClose";
      helperSLForwardVehicleSensorFusionSetup("scenarioFcnName",scenarioName);
    cleanup callback:
      helperPlotForwardVehicleSensorFusionResults(sltest_simout.logsout);

  case "scenario_LFACC_06_Straight_StopandGoLeadCar" [simulation]
    model ForwardVehicleSensorFusionTestBench
    post-load callback:
      scenarioName = "scenario_LFACC_06_Straight_StopandGoLeadCar";
      helperSLForwardVehicleSensorFusionSetup("scenarioFcnName",scenarioName);
    cleanup callback:
      helperPlotForwardVehicleSensorFusionResults(sltest_simout.logsout);

  case "scenario_FVSF_01_Curve_FourVehicles" [simulation]
    model ForwardVehicleSensorFusionTestBench
    post-load callback:
      scenarioName = "scenario_FVSF_01_Curve_FourVehicles";
      helperSLForwardVehicleSensorFusionSetup("scenarioFcnName",scenarioName);
    cleanup callback:
      helperPlotForwardVehicleSensorFusionResults(sltest_simout.logsout);

  case "scenario_FVSF_02_Straight_FourVehicles" [simulation]
    model ForwardVehicleSensorFusionTestBench
    post-load callback:
      scenarioName = "scenario_FVSF_02_Straight_FourVehicles";
      helperSLForwardVehicleSensorFusionSetup("scenarioFcnName",scenarioName);
    cleanup callback:
      helperPlotForwardVehicleSensorFusionResults(sltest_simout.logsout);

  case "scenario_FVSF_03_Curve_SixVehicles" [simulation]
    model ForwardVehicleSensorFusionTestBench
    post-load callback:
      scenarioName = "scenario_FVSF_03_Curve_SixVehicles";
      helperSLForwardVehicleSensorFusionSetup("scenarioFcnName",scenarioName);
    cleanup callback:
      helperPlotForwardVehicleSensorFusionResults(sltest_simout.logsout);

  case "scenario_FVSF_04_Straight_ThreeVehicles" [simulation]
    model ForwardVehicleSensorFusionTestBench
    post-load callback:
      scenarioName = "scenario_FVSF_04_Straight_ThreeVehicles";
      helperSLForwardVehicleSensorFusionSetup("scenarioFcnName",scenarioName);
    cleanup callback:
      helperPlotForwardVehicleSensorFusionResults(sltest_simout.logsout);
    assessment "Assessment1": At any point of time, whenever Time > 0.2 is true then, with no delay, MissedTarget == 0 must be true
      Time: signal ForwardVehicleSensorFusionTestBench/Sensors and Environment/Digital Clock, port 1
      MissedTarget: signal ForwardVehicleSensorFusionTestBench/Evaluate Tracker Metrics/GOSPA Metric, port 3

  case "scenario_FVSF_05_Straight_TwoVehicles" [simulation]
    model ForwardVehicleSensorFusionTestBench
    post-load callback:
      scenarioName = "scenario_FVSF_05_Straight_TwoVehicles";
      helperSLForwardVehicleSensorFusionSetup("scenarioFcnName",scenarioName);
    cleanup callback:
      helperPlotForwardVehicleSensorFusionResults(sltest_simout.logsout);
    assessment "Assessment1": At any point of time, whenever Time > 0.2 is true then, with no delay, MissedTarget == 0 must be true
      Time: signal ForwardVehicleSensorFusionTestBench/Sensors and Environment/Digital Clock, port 1
      MissedTarget: signal ForwardVehicleSensorFusionTestBench/Evaluate Tracker Metrics/GOSPA Metric, port 3