test file "HighwayLaneFollowingTestAssessments"

suite "Test Scenarios"

  case "scenario_LFACC_01_Curve_DecelTarget" [simulation]
    model HighwayLaneFollowingTestBench
    pre-load callback:
      assignin('base','cameraOutputFileDir',pwd);
    post-load callback:
      scenarioName = "scenario_LFACC_01_Curve_DecelTarget";
      helperSLHighwayLaneFollowingSetup("scenarioFcnName",scenarioName);
      % Configure output video file name
      cameraOutputFileDir = evalin('base','cameraOutputFileDir');
      set_param("HighwayLaneFollowingTestBench/Simulation 3D Scenario/To Multimedia File",...
          'outputFilename', cameraOutputFileDir+"/"+scenarioName+'.mp4');
    cleanup callback:
      helperGenerateFilesForLaneFollowingReport(sltest_simout.logsout);

  case "scenario_LFACC_02_Curve_AutoRetarget" [simulation]
    model HighwayLaneFollowingTestBench
    pre-load callback:
      assignin('base','cameraOutputFileDir',pwd);
    post-load callback:
      scenarioName = "scenario_LFACC_02_Curve_AutoRetarget";
      helperSLHighwayLaneFollowingSetup("scenarioFcnName",scenarioName);
      % Configure output video file name
      cameraOutputFileDir = evalin('base','cameraOutputFileDir');
      set_param("HighwayLaneFollowingTestBench/Simulation 3D Scenario/To Multimedia File",...
          'outputFilename', cameraOutputFileDir+"/"+scenarioName+'.mp4');
    cleanup callback:
      helperGenerateFilesForLaneFollowingReport(sltest_simout.logsout);

  case "scenario_LFACC_03_Curve_StopnGo" [simulation]
    model HighwayLaneFollowingTestBench
    pre-load callback:
      assignin('base','cameraOutputFileDir',pwd);
    post-load callback:
      scenarioName = "scenario_LFACC_03_Curve_StopnGo";
      helperSLHighwayLaneFollowingSetup("scenarioFcnName",scenarioName);

      % Configure output video file name
      cameraOutputFileDir = evalin('base','cameraOutputFileDir');
      set_param("HighwayLaneFollowingTestBench/Simulation 3D Scenario/To Multimedia File",...
          'outputFilename', cameraOutputFileDir+"/"+scenarioName+'.mp4');
    cleanup callback:
      helperGenerateFilesForLaneFollowingReport(sltest_simout.logsout);

  case "scenario_LFACC_04_Curve_CutInOut" [simulation]
    model HighwayLaneFollowingTestBench
    pre-load callback:
      assignin('base','cameraOutputFileDir',pwd);
    post-load callback:
      scenarioName = "scenario_LFACC_04_Curve_CutInOut";
      helperSLHighwayLaneFollowingSetup("scenarioFcnName",scenarioName);
      % Configure output video file name
      cameraOutputFileDir = evalin('base','cameraOutputFileDir');
      set_param("HighwayLaneFollowingTestBench/Simulation 3D Scenario/To Multimedia File",...
          'outputFilename', cameraOutputFileDir+"/"+scenarioName+'.mp4');
    cleanup callback:
      helperGenerateFilesForLaneFollowingReport(sltest_simout.logsout);

  case "scenario_LFACC_05_Curve_CutInOut_TooClose" [simulation]
    model HighwayLaneFollowingTestBench
    pre-load callback:
      assignin('base','cameraOutputFileDir',pwd);
    post-load callback:
      scenarioName = "scenario_LFACC_05_Curve_CutInOut_TooClose";
      helperSLHighwayLaneFollowingSetup("scenarioFcnName",scenarioName);
      % Configure output video file name
      cameraOutputFileDir = evalin('base','cameraOutputFileDir');
      set_param("HighwayLaneFollowingTestBench/Simulation 3D Scenario/To Multimedia File",...
          'outputFilename', cameraOutputFileDir+"/"+scenarioName+'.mp4');
    cleanup callback:
      helperGenerateFilesForLaneFollowingReport(sltest_simout.logsout);

  case "scenario_LFACC_06_Straight_StopandGoLeadCar" [simulation]
    model HighwayLaneFollowingTestBench
    pre-load callback:
      assignin('base','cameraOutputFileDir',pwd);
    post-load callback:
      scenarioName = "scenario_LFACC_06_Straight_StopandGoLeadCar";
      helperSLHighwayLaneFollowingSetup("scenarioFcnName",scenarioName);
      % Configure output video file name
      cameraOutputFileDir = evalin('base','cameraOutputFileDir');
      set_param("HighwayLaneFollowingTestBench/Simulation 3D Scenario/To Multimedia File",...
          'outputFilename', cameraOutputFileDir+"/"+scenarioName+'.mp4');
    cleanup callback:
      helperGenerateFilesForLaneFollowingReport(sltest_simout.logsout);

  case "scenario_LF_01_Straight_RightLane" [simulation]
    model HighwayLaneFollowingTestBench
    pre-load callback:
      assignin('base','cameraOutputFileDir',pwd);
    post-load callback:
      scenarioName = "scenario_LF_01_Straight_RightLane";
      helperSLHighwayLaneFollowingSetup("scenarioFcnName",scenarioName);
      % Configure output video file name
      cameraOutputFileDir = evalin('base','cameraOutputFileDir');
      set_param("HighwayLaneFollowingTestBench/Simulation 3D Scenario/To Multimedia File",...
          'outputFilename', cameraOutputFileDir+"/"+scenarioName+'.mp4');
    cleanup callback:
      helperGenerateFilesForLaneFollowingReport(sltest_simout.logsout);

  case "scenario_LF_02_Straight_LeftLane" [simulation]
    model HighwayLaneFollowingTestBench
    pre-load callback:
      assignin('base','cameraOutputFileDir',pwd);
    post-load callback:
      scenarioName = "scenario_LF_02_Straight_LeftLane";
      helperSLHighwayLaneFollowingSetup("scenarioFcnName",scenarioName);

      % Configure output video file name
      cameraOutputFileDir = evalin('base','cameraOutputFileDir');
      set_param("HighwayLaneFollowingTestBench/Simulation 3D Scenario/To Multimedia File",...
          'outputFilename', cameraOutputFileDir+"/"+scenarioName+'.mp4');
    cleanup callback:
      helperGenerateFilesForLaneFollowingReport(sltest_simout.logsout);

  case "scenario_LF_03_Curve_LeftLane" [simulation]
    model HighwayLaneFollowingTestBench
    pre-load callback:
      assignin('base','cameraOutputFileDir',pwd);
    post-load callback:
      scenarioName = "scenario_LF_03_Curve_LeftLane";
      helperSLHighwayLaneFollowingSetup("scenarioFcnName",scenarioName);
      % Configure output video file name
      cameraOutputFileDir = evalin('base','cameraOutputFileDir');
      set_param("HighwayLaneFollowingTestBench/Simulation 3D Scenario/To Multimedia File",...
          'outputFilename', cameraOutputFileDir+"/"+scenarioName+'.mp4');
    cleanup callback:
      helperGenerateFilesForLaneFollowingReport(sltest_simout.logsout);

  case "scenario_LF_04_Curve_RightLane" [simulation]
    model HighwayLaneFollowingTestBench
    pre-load callback:
      assignin('base','cameraOutputFileDir',pwd);
    post-load callback:
      scenarioName = "scenario_LF_04_Curve_RightLane";
      helperSLHighwayLaneFollowingSetup("scenarioFcnName",scenarioName);
      % Configure output video file name
      cameraOutputFileDir = evalin('base','cameraOutputFileDir');
      set_param("HighwayLaneFollowingTestBench/Simulation 3D Scenario/To Multimedia File",...
          'outputFilename', cameraOutputFileDir+"/"+scenarioName+'.mp4');
    cleanup callback:
      helperGenerateFilesForLaneFollowingReport(sltest_simout.logsout);