test file "LaneMarkerDetectorTestAssessments"
  coverage: Decision, Condition

suite "Test Scenarios"

  case "scenario_LF_01_Straight_RightLane" [simulation]
    model LaneMarkerDetectorTestBench
    pre-load callback:
      assignin('base','cameraOutputFileDir',pwd);
    post-load callback:
      scenarioName = "scenario_LF_01_Straight_RightLane";
      helperSLLaneMarkerDetectorSetup(scenarioName);
      % Configure output video file name
      cameraOutputFileDir = evalin('base','cameraOutputFileDir');
      set_param("LaneMarkerDetectorTestBench/Simulation 3D Scenario/To Multimedia File",...
          'outputFilename', cameraOutputFileDir+"/"+scenarioName+'.mp4');
    cleanup callback:
      helperGenerateReportForLaneMarkerDetector(sltest_simout.logsout);
    custom criteria:
      % Thresholds for precision and sensitivity
      precisionThreshold = 90;
      sensitivityThreshold = 90;
      % Verify if the precision and sensitivity are greater than the thresholds
      helperVerifyPrecisionAndSensitivity(test,precisionThreshold,sensitivityThreshold);

  case "scenario_LF_02_Straight_LeftLane" [simulation]
    model LaneMarkerDetectorTestBench
    pre-load callback:
      assignin('base','cameraOutputFileDir',pwd);
    post-load callback:
      scenarioName = "scenario_LF_02_Straight_LeftLane";
      helperSLLaneMarkerDetectorSetup(scenarioName);
      % Configure output video file name
      cameraOutputFileDir = evalin('base','cameraOutputFileDir');
      set_param("LaneMarkerDetectorTestBench/Simulation 3D Scenario/To Multimedia File",...
          'outputFilename', cameraOutputFileDir+"/"+scenarioName+'.mp4');
    cleanup callback:
      helperGenerateReportForLaneMarkerDetector(sltest_simout.logsout);
    custom criteria: same code as in custom criteria of case "scenario_LF_01_Straight_RightLane"

  case "scenario_LF_03_Curve_LeftLane" [simulation]
    model LaneMarkerDetectorTestBench
    pre-load callback:
      assignin('base','cameraOutputFileDir',pwd);
    post-load callback:
      scenarioName = "scenario_LF_03_Curve_LeftLane";
      helperSLLaneMarkerDetectorSetup(scenarioName);
      % Configure output video file name
      cameraOutputFileDir = evalin('base','cameraOutputFileDir');
      set_param("LaneMarkerDetectorTestBench/Simulation 3D Scenario/To Multimedia File",...
          'outputFilename', cameraOutputFileDir+"/"+scenarioName+'.mp4');
    cleanup callback:
      helperGenerateReportForLaneMarkerDetector(sltest_simout.logsout);
    custom criteria: same code as in custom criteria of case "scenario_LF_01_Straight_RightLane"

  case "scenario_LF_04_Curve_RightLane" [simulation]
    model LaneMarkerDetectorTestBench
    pre-load callback:
      assignin('base','cameraOutputFileDir',pwd);
    post-load callback:
      scenarioName = "scenario_LF_04_Curve_RightLane";
      helperSLLaneMarkerDetectorSetup(scenarioName);
      % Configure output video file name
      cameraOutputFileDir = evalin('base','cameraOutputFileDir');
      set_param("LaneMarkerDetectorTestBench/Simulation 3D Scenario/To Multimedia File",...
          'outputFilename', cameraOutputFileDir+"/"+scenarioName+'.mp4');
    cleanup callback:
      helperGenerateReportForLaneMarkerDetector(sltest_simout.logsout);
    custom criteria: same code as in custom criteria of case "scenario_LF_01_Straight_RightLane"

  case "scenario_LD_01_Curve_ThreeVehicles" [simulation]
    model LaneMarkerDetectorTestBench
    pre-load callback:
      assignin('base','cameraOutputFileDir',pwd);
    post-load callback:
      scenarioName = "scenario_LD_01_Curve_ThreeVehicles";
      helperSLLaneMarkerDetectorSetup(scenarioName);
      % Configure output video file name
      cameraOutputFileDir = evalin('base','cameraOutputFileDir');
      set_param("LaneMarkerDetectorTestBench/Simulation 3D Scenario/To Multimedia File",...
          'outputFilename', cameraOutputFileDir+"/"+scenarioName+'.mp4');
    cleanup callback:
      helperGenerateReportForLaneMarkerDetector(sltest_simout.logsout);
    custom criteria:
      % Thresholds for precision and sensitivity
      precisionThreshold = 75;
      sensitivityThreshold = 75;
      % Verify if the precision and sensitivity are greater than the thresholds
      helperVerifyPrecisionAndSensitivity(test,precisionThreshold,sensitivityThreshold);

  case "scenario_LD_02_Curve_SixVehicles" [simulation]
    model LaneMarkerDetectorTestBench
    pre-load callback:
      assignin('base','cameraOutputFileDir',pwd);
    post-load callback:
      scenarioName = "scenario_LD_02_Curve_SixVehicles";
      helperSLLaneMarkerDetectorSetup(scenarioName);
      % Configure output video file name
      cameraOutputFileDir = evalin('base','cameraOutputFileDir');
      set_param("LaneMarkerDetectorTestBench/Simulation 3D Scenario/To Multimedia File",'outputFilename', cameraOutputFileDir+"/"+scenarioName+'.mp4');
    cleanup callback:
      helperGenerateReportForLaneMarkerDetector(sltest_simout.logsout);
    custom criteria: same code as in custom criteria of case "scenario_LF_01_Straight_RightLane"